# Grasshopper definition serial.gh (Grasshopper 1.0.8)
# plug-ins: CRFT Tools

list = SerialPorts({"cu.debug-console", "cu.JBLRACETWS", "cu.Bluetooth-Incoming-Port", "cu.usbserial-140"}, selected="cu.debug-console")
boolean_toggle = BooleanToggle(True)
panel = Panel("""G28
G0 X200
G0 Y200
G0 Z200""")
serial_control = SerialControl(Port=list, BaudRate=115200, Connect=False, Command=panel, Send=Button(), Clear=False)  # -> Response, PortEvent
panel_2 = Panel(serial_control.Response)
panel_3 = Panel(serial_control.PortEvent)
