# Grasshopper definition tests_for_gcode.gh (Grasshopper 1.0.8)
# plug-ins: CRFT Tools

number_slider = Slider(11, range=0..100)
multiplication = Multiplication(A=number_slider, B=Slider(2.5, range=0..10))
circle = Circle(Plane=PlaneXY(0, 0, 0), Radius=number_slider)
unit_z = UnitZ(Factor=multiplication)
extrude = Extrude(Base=circle, Direction=unit_z)
cap_holes = CapHoles(Brep=extrude)
slicer_settings = SlicerSettings(
    LayerHeight=0.2,
    WallOffset=0.4,
    Shells=2,
    InfillSpacing=10,
    PrintSpeed=1500,
    NozzleDiameter=0.4,
    BedWidth=200,
    BedDepth=200,
    MaxSegmentLength=0)
brep = Brep(cap_holes)
slice_geometry = SliceGeometry(Geometry=brep, Settings=slicer_settings)  # -> Layers, L
g_code_generator = GCodeGenerator(Settings=slicer_settings, Layers=slice_geometry.L)
boolean_toggle = BooleanToggle(False)
button = Button()
panel = Panel(g_code_generator)
number_slider_2 = Slider(220, range=0..1000)
number_slider_3 = Slider(20, range=0..100)
boolean_toggle_2 = BooleanToggle(True)
